# Grasshopper definition inflatables.gh (Grasshopper 1.0.7)
# plug-ins: Kangaroo2 Components, Bifocals, Weaverbird, MeshEdit Components, DendroGH, Human, MetaHopper

crv = Curve(<curve referenced from the Rhino model>)
crv_2 = Curve(<curve referenced from the Rhino model>)

# ---- group: boundary curve
crv_3 = Curve(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)

# ----
loft = Loft(Curves=[crv, crv_2], Options={Adjust=False, Closed=False, LoftEnds=0, LoftSimp=0, LoftType=0, Rebuild=10, Refit=0.01})

number_slider = Slider(11, range=0..100)
rectangle = Rectangle(Plane=PlaneXY(0, 0, 0), XSize=number_slider, YSize=number_slider, Radius=0)  # -> Rectangle, Length
dom = ConstructDomain(DomainStart=Slider(0.88, range=0..1), DomainEnd=Slider(2.91, range=0..10))
pop2d = Populate2D(Region=rectangle.Rectangle, Count=Slider(7, range=0..10), Seed=1)
lng = ListLength(List=pop2d)
random = Random(Range=lng, Number=dom, Seed=2)
cir = Circle(Plane=pop2d, Radius=random)
Z = UnitZ(Factor=Slider(3, range=0..10))
runion = RegionUnion(Curves=cir)
Z_2 = UnitZ(Factor=Slider(0.18, range=0..1))
boundary = BoundarySurfaces(Edges=runion)
move = Move(Geometry=runion, Motion=Z)  # -> Geometry, Transform
boundary_2 = BoundarySurfaces(Edges=move.Geometry)
extr = Extrude(Base=boundary, Direction=Z_2)
mesh = Mesh(boundary_2)
divide = DivideCurve(Curve=move.Geometry, Count=Slider(30, range=0..100), Kinks=False)  # -> Points, Tangents, Parameters
pipe = Pipe(Curve=move.Geometry, Radius=Slider(0.06, range=0..0.1), Caps=0)
nv = NakedVertices(Mesh=mesh)  # -> ClothedIndex, NakedIndex, ClothedPts, NakedPts
Z_3 = UnitZ(Factor=Slider(2, range=0..10))
show = Show(G=mesh)
edgelengths = EdgeLengths(Mesh=mesh, LengthFactor=Slider(0.08, range=0..0.1), Strength=1)
dispatch = Dispatch(List=divide.Points, DispatchPattern=[True, False])  # -> ListA, ListB
anchor = Anchor(Point=nv.NakedPts, Strength=10000)
pt = ConstructPoint(XCoordinate=0, YCoordinate=0, ZCoordinate=Slider(0.18, range=0..1))
load = Load(Point=nv.ClothedPts, ForceVector=Z_3, Weighting=1)
geo = Geometry(dispatch.ListA)
geo_2 = Geometry(dispatch.ListB)
shift = ShiftList(List=geo_2, Shift=Slider(14, range=0..100), Wrap=True)
project = Project(Geometry=geo, Plane=pt)  # -> Geometry, Transform
solver = Solver(GoalObjects=[show, edgelengths, load, anchor], Reset=Button(), Threshold=1e-15, Tolerance=0.01, On=Toggle(True))  # -> I, V, O
bang = ExplodeTree(Data=solver.O)  # -> _0000, _00000
ln = Line(StartPoint=geo_2, EndPoint=project.Geometry)
ln_2 = Line(StartPoint=project.Geometry, EndPoint=shift)
mesh_2 = Mesh(bang._0000)
join = JoinCurves(Curves=flatten([ln_2, ln]), Preserve=False)
wbloop = WeaverbirdsLoopSubdivision(MeshCurves=mesh_2, Level=1, SmoothNakedEdges=1)
divide_2 = DivideCurve(Curve=join, Count=Slider(1000, range=0..1000), Kinks=False)  # -> Points, Tangents, Parameters
intcrv = Interpolate(Vertices=divide_2.Points, Degree=3, Periodic=invert(False), KnotStyle=1)  # -> Curve, Length, Domain
wbframe = WeaverbirdsPictureFrame(MeshPolylines=wbloop, Distance=5, InsetType=0)
pipe_2 = Pipe(Curve=intcrv.Curve, Radius=Slider(0.045, range=0..0.1), Caps=0)
wbthicken = WeaverbirdsMeshThicken(MeshCurves=wbframe, Distance=Slider(0.06, range=0..0.1), OffsetType=0)
# comprueba: es la casa da musica?
wbcatmullclark = WeaverbirdsCatmullClarkSubdivision(MeshCurves=wbthicken, Level=Slider(3, range=0..10), SmoothNakedEdges=1)

mesh_3 = Mesh(crv_3)
mesh_4 = Mesh(crv)
triremesh = TriRemesh(Geometry=mesh_4, Length=1, Iterations=25)  # -> Triangulation, Dual, Creases
neg = Negative(Value=Slider(1252.659, range=0..20101))
nv_2 = NakedVertices(Mesh=triremesh.Triangulation)  # -> ClothedIndex, NakedIndex, ClothedPts, NakedPts
edgelengths_2 = EdgeLengths(Mesh=triremesh.Triangulation, LengthFactor=Slider(0.67, range=0..1), Strength=1)
volume = Volume(Mesh=triremesh.Triangulation, Volume=neg, Strength=1)
anchor_2 = Anchor(Point=nv_2.NakedPts, Strength=10000)
show_2 = Show(G=triremesh.Triangulation)
# half sphere script (NEED FIXING)
number_slider_2 = Slider(10, range=0..10)
number_slider_3 = Slider(855, range=0..1000)
# sphere
number_slider_4 = Slider(20, range=0..100)
number_slider_5 = Slider(10, range=0..10)

# ----
# not sure this is really parametric
number_slider_6 = Slider(20, range=0..100)  # disabled
# CUBE
number_slider_7 = Slider(10, range=0..10)  # disabled
box = CenterBox(Base=PlaneXY(0, 0, 0), X=number_slider_6, Y=number_slider_6, Z=number_slider_6)  # disabled
debrep = DeconstructBrep(Brep=box)  # -> Faces, Edges, Vertices; disabled
area = Area(Geometry=debrep.Faces)  # -> Area, Centroid; disabled
number_slider_8 = Slider(0.1, range=0..0.1)  # disabled
pln = Plane(area.Centroid)  # disabled
number_slider_9 = Slider(25, range=0..100)  # disabled
pdecon = Deconstruct(Point=area.Centroid)  # -> XComponent, YComponent, ZComponent; disabled
abs = Absolute(Value=pdecon.ZComponent)  # disabled
smaller = SmallerThan(FirstNumber=abs, SecondNumber=number_slider_8)  # -> SmallerThan, OrEqualTo; disabled
sph = Sphere(Base=PlaneXY(0, 0, 0), Radius=number_slider_9)  # disabled
cull = CullPattern(List=debrep.Faces, CullPattern=smaller.SmallerThan)  # disabled
panel = Panel(smaller.SmallerThan)  # disabled
cull_2 = CullPattern(List=area.Centroid, CullPattern=smaller.SmallerThan)  # disabled
item = ListItem(List=cull, Index=0, Wrap=True)  # -> Item, Item1, Item2, Item3; disabled
panel_2 = Panel("{0.5, 0.5, 0}")  # disabled
number_slider_10 = Slider(10, range=0..10)  # disabled
brep = Brep(box)  # disabled
evalsrf = EvaluateSurface(Surface=reparameterize(cull), Point=panel_2)  # -> Point, Normal, UDirection, VDirection, Frame; disabled
number_slider_11 = Slider(9, range=0..10)  # disabled
amp = Amplitude(Vector=evalsrf.Normal, Amplitude=number_slider_10)  # disabled
pt_2 = Point(evalsrf.Point)  # disabled
srf_cp = SurfaceClosestPoint(Point=pt_2, Surface=sph)  # -> Point, UVPoint, Distance; disabled
pln_2 = Plane(evalsrf.Frame)  # disabled
rectangle_2 = Rectangle(Plane=pln_2, XSize=number_slider_11, YSize=number_slider_11, Radius=0)  # -> Rectangle, Length; disabled
move_2 = Move(Geometry=pt_2, Motion=amp)  # -> Geometry, Transform; disabled
area_2 = Area(Geometry=rectangle_2.Rectangle)  # -> Area, Centroid; disabled
orient = Orient(Geometry=rectangle_2.Rectangle, Source=area_2.Centroid, Target=pt_2)  # -> Geometry, Transform; disabled
ln_3 = Line(StartPoint=pt_2, EndPoint=move_2.Geometry)  # disabled
extrcrv = ExtrudeAlong(Base=orient.Geometry, Curve=ln_3)  # disabled
area_3 = Area(Geometry=extrcrv)  # -> Area, Centroid; disabled
orient_2 = Orient(Geometry=extrcrv, Source=area_3.Centroid, Target=pt_2)  # -> Geometry, Transform; disabled
sdiff = SolidDifference(BrepsA=orient_2.Geometry, BrepsB=brep)  # disabled
splitmul = SplitBrepMultiple(Brep=orient_2.Geometry, Cutters=brep)  # disabled
splitmul_2 = SplitBrepMultiple(Brep=brep, Cutters=orient_2.Geometry)  # disabled
item_2 = ListItem(List=splitmul, Index=0, Wrap=True)  # -> flatten(Item); disabled
item_3 = ListItem(List=splitmul_2, Index=0, Wrap=True)  # disabled
panel_3 = Panel(item_2)  # disabled
mesh_5 = Mesh(item_3)  # disabled
mesh_6 = Mesh(item_2)  # disabled
merge = Merge(Data1=mesh_5, Data2=mesh_6)  # -> flatten(Result); disabled
mjoin = MeshJoin(Meshes=merge)  # disabled
panel_4 = Panel(mjoin)  # disabled
weldvertices = MeshWeldVertices(Mesh=mjoin, Tolerance=0.01)  # -> RuntimeMessage, Mesh; disabled
unifynormals = MeshUnifyNormals(Mesh=weldvertices.Mesh)  # disabled
mesh_7 = Mesh(unifynormals)  # disabled
nv_3 = NakedVertices(Mesh=mesh_7)  # -> ClothedIndex, NakedIndex, ClothedPts, NakedPts; disabled
pt_3 = Point(nv_3.NakedPts)  # disabled
refine = Refine(Mesh=mesh_7, Level=1)  # disabled
mesh_8 = Mesh(refine)  # disabled
medges = MeshEdges(Mesh=mesh_8)  # -> NakedEdges, InteriorEdges, NonManifoldEdges; disabled
line = Line(medges.NakedEdges)  # disabled
panel_5 = Panel("""0
11
14
19""")  # disabled
join_2 = JoinCurves(Curves=line, Preserve=False)  # disabled
number_slider_12 = Slider(4, range=0..10)  # disabled
item_4 = ListItem(List=join_2, Index=panel_5, Wrap=True)  # disabled
panel_6 = Panel("4")  # disabled
multiplication = Multiplication(A=number_slider_12, B=panel_6)  # disabled
explode = Explode(Curve=item_4, Recursive=True)  # -> Segments, Vertices; disabled
divide_3 = DivideCurve(Curve=item_4, Count=multiplication, Kinks=False)  # -> Points, Tangents, Parameters; disabled
duppt = RemoveDuplicatePts(Points=divide_3.Points, Tolerance=0.01)  # disabled
plfit = PlaneFit(Points=duppt)  # -> Plane, Deviation; disabled
avr = Average(Input=duppt)  # disabled
number_slider_13 = Slider(10, range=0..10)  # disabled
pl_origin = PlaneOrigin(Base=plfit.Plane, Origin=avr)  # disabled
cir_2 = Circle(Plane=pl_origin, Radius=number_slider_13)  # disabled
crv_cp = CurveClosestPoint(Point=duppt, Curve=cir_2)  # -> Point, Parameter, Distance; disabled
number_slider_14 = Slider(0.501, range=0..1)  # disabled
pt_4 = Point(simplify(crv_cp.Point))  # disabled
pt_5 = Point(simplify(duppt))  # disabled
edgelengths_3 = EdgeLengths(Mesh=mesh_8, LengthFactor=number_slider_14, Strength=1)  # disabled
anchor_3 = Anchor(Point=pt_5, Target=pt_4, Strength=10000)  # disabled
ln_4 = Line(StartPoint=pt_5, EndPoint=pt_4)  # disabled
show_3 = Show(G=mesh_8)  # disabled
merge_2 = Merge(Data1=flatten(show_3), Data2=flatten(edgelengths_3), Data3=flatten(anchor_3))  # disabled
toggle = BooleanToggle(False)  # disabled
button = Button()  # disabled
number_slider_15 = Slider(0.72, range=0..1)  # disabled
toggle_2 = GroupToggle(ToggleActive=True, ToggleVisible=False)  # disabled
bouncysolver = BouncySolver(GoalObjects=merge_2, Reset=button, Threshold=1e-15, Tolerance=0.0001, Damping=number_slider_15, Iterations=10, On=toggle)  # -> I, V, O; disabled
previewmat = CustomPreviewMaterials(Geometry=bouncysolver.O, DiffuseColor=RGB(255, 255, 255))  # disabled

xy = XYPlane(Origin=Point(0, 0, 0))
entwine = Entwine(Branch00=show_2, Branch01=[anchor_2, volume, edgelengths_2], FlattenInputs=True)
sph_2 = Sphere(Base=PlaneXY(0, 0, 0), Radius=number_slider_2)
rectangle_3 = Rectangle(Plane=xy, XSize=number_slider_3, YSize=number_slider_3, Radius=0)  # -> Rectangle, Length
solver_2 = Solver(GoalObjects=entwine, Reset=Button(), Threshold=1e-15, Tolerance=0.01, On=Toggle(True))  # -> I, V, O
box_2 = CenterBox(Base=PlaneXY(0, 0, 0), X=number_slider_4, Y=number_slider_4, Z=number_slider_4)
area_4 = Area(Geometry=rectangle_3.Rectangle)  # -> Area, Centroid
debrep_2 = DeconstructBrep(Brep=box_2)  # -> Faces, Edges, Vertices
number_slider_16 = Slider(192, range=0..200)
bang_2 = ExplodeTree(Data=solver_2.O)  # -> Branch0, Branch1
orient_3 = Orient(Geometry=rectangle_3.Rectangle, Source=area_4.Centroid, Target=xy)  # -> Geometry, Transform
xy_2 = XYPlane(Origin=Point(0, 0, 0))
area_5 = Area(Geometry=debrep_2.Faces)  # -> Area, Centroid
pln_3 = Plane(area_5.Centroid)
mesh_9 = Mesh(bang_2.Branch0)
boundary_3 = BoundarySurfaces(Edges=orient_3.Geometry)
sph_3 = Sphere(Base=PlaneXY(0, 0, 0), Radius=Slider(29, range=0..100))
preview = CustomPreview(
    Geometry=mesh_9,
    Material={diffuse=RGB(0, 128, 0), emission=RGB(0, 0, 0), shine=0.5, specular=RGB(255, 255, 255), transparency=0.1})
rectangle_4 = Rectangle(Plane=xy_2, XSize=number_slider_16, YSize=number_slider_16, Radius=0)  # -> Rectangle, Length
pdecon_2 = Deconstruct(Point=area_5.Centroid)  # -> XComponent, YComponent, ZComponent

larger = LargerThan(FirstNumber=pdecon_2.ZComponent, SecondNumber=Slider(1, range=0..1))  # -> LargerThan, OrEqualTo
cull_3 = CullPattern(List=area_5.Centroid, CullPattern=larger.LargerThan)

split = SplitBrep(Brep=sph_2, Cutter=boundary_3)
abs_2 = Absolute(Value=pdecon_2.ZComponent)
item_5 = ListItem(List=split, Index=0, Wrap=True)
smaller_2 = SmallerThan(FirstNumber=abs_2, SecondNumber=Slider(0.1, range=0..0.1))  # -> SmallerThan, OrEqualTo
xy_3 = XYPlane(Origin=Point(0, 0, 0))
brep_2 = Brep(item_5)
pop2d_2 = Populate2D(Region=rectangle_4.Rectangle, Count=Slider(76, range=0..100), Seed=Slider(4, range=0..10))
cull_4 = CullPattern(List=debrep_2.Faces, CullPattern=smaller_2.SmallerThan)
panel_7 = Panel(smaller_2.SmallerThan)
del = DelaunayMesh(Points=pop2d_2, Plane=xy_3)
hull = ConvexHull(Points=pop2d_2, Plane=xy_3)  # -> Hull, HullZ, Indices
cull_5 = CullPattern(List=area_5.Centroid, CullPattern=smaller_2.SmallerThan)
item_6 = ListItem(List=cull_4, Index=0, Wrap=True)  # -> Item, Item1, Item2, Item3
pt_6 = Point(cull_3)
number_slider_17 = Slider(50, range=0..100)
debrep_3 = DeconstructBrep(Brep=brep_2)  # -> Faces, Edges, Vertices
demesh = DeconstructMesh(Mesh=del)  # -> Vertices, Faces, Colours, Normals
item_7 = ListItem(List=debrep_3.Edges, Index=0, Wrap=True)
neg_2 = Negative(Value=Slider(53.6, range=0..100))
brep_3 = Brep(sph_3)
divide_4 = DivideCurve(Curve=item_7, Count="4", Kinks=False)  # -> Points, Tangents, Parameters
avr_2 = Average(Input=demesh.Vertices)
evalsrf_2 = EvaluateSurface(Surface=reparameterize(cull_4), Point="{0.5, 0.5, 0}")  # -> Point, Normal, UDirection, VDirection, Frame
Z_4 = UnitZ(Factor=neg_2)
number_slider_18 = Slider(10, range=0..10)
crv_cp_2 = CurveClosestPoint(Point=demesh.Vertices, Curve=hull.Hull)  # -> Point, Parameter, Distance
amp_2 = Amplitude(Vector=evalsrf_2.Normal, Amplitude=Slider(10, range=0..10))
number_slider_19 = Slider(20, range=0..100)
move_3 = Move(Geometry=avr_2, Motion=Z_4)  # -> Geometry, Transform
pt_7 = Point(evalsrf_2.Point)
srf_cp_2 = SurfaceClosestPoint(Point=pt_7, Surface=sph_3)  # -> Point, UVPoint, Distance
shatter = Shatter(Curve=item_7, Parameters=divide_4.Parameters)
pln_4 = Plane(evalsrf_2.Frame)
bool = Boolean(crv_cp_2.Distance)
vec2pt = Vector2Pt(PointA=move_3.Geometry, PointB=demesh.Vertices, Unitize=False)  # -> Vector, Length
eval = EvaluateCurve(Curve=reparameterize(shatter), Parameter=Slider(0.4, range=0..1))  # -> Point, Tangent, Angle
move_4 = Move(Geometry=pt_7, Motion=amp_2)  # -> Geometry, Transform
int = Integer(bool)
dist = Distance(PointA=divide_4.Points, PointB=eval.Point)
rectangle_5 = Rectangle(Plane=pln_4, XSize=number_slider_18, YSize=number_slider_18, Radius=0)  # -> Rectangle, Length
bnd = Bounds(Numbers=vec2pt.Length)
area_6 = Area(Geometry=rectangle_5.Rectangle)  # -> Area, Centroid
round = Round(Number=dist)  # -> Nearest, Floor, Ceiling

# ---- group: define height
ln_5 = Line(StartPoint=divide_4.Points, EndPoint=eval.Point)
multiplication_2 = Multiplication(A=round.Nearest, B="0.5")
midpt = CurveMiddle(Curve=ln_5)
Z_5 = UnitZ(Factor=multiplication_2)
move_5 = Move(Geometry=midpt, Motion=Z_5)  # -> Geometry, Transform

# ----
dom_2 = ConstructDomain(DomainStart=Slider(100, range=0..100), DomainEnd="0")
panel_8 = Panel(round.Nearest)
remap = RemapNumbers(Value=vec2pt.Vector, Source=bnd, Target=dom_2)  # -> Mapped, Clipped
orient_4 = Orient(Geometry=rectangle_5.Rectangle, Source=area_6.Centroid, Target=pt_7)  # -> Geometry, Transform
ln_6 = Line(StartPoint=pt_7, EndPoint=move_4.Geometry)
multiplication_3 = Multiplication(A=int, B=remap.Mapped)
arc = Arc3Pt(PointA=divide_4.Points, PointB=move_5.Geometry, PointC=eval.Point)  # -> Arc, Plane, Radius
amp_3 = Amplitude(Vector=vec2pt.Vector, Amplitude=multiplication_3)
extrcrv_2 = ExtrudeAlong(Base=orient_4.Geometry, Curve=ln_6)
area_7 = Area(Geometry=extrcrv_2)  # -> Area, Centroid
move_6 = Move(Geometry=demesh.Vertices, Motion=amp_3)  # -> Geometry, Transform
pln_5 = Plane(arc.Plane)
vec = Vector(pln_5)
conmesh = ConstructMesh(Vertices=move_6.Geometry, Faces=demesh.Faces)
move_7 = Move(Geometry=arc.Arc, Motion=vec)  # -> Geometry, Transform
amp_4 = Amplitude(Vector=vec, Amplitude=Slider(-3, range=-10..10))
faceb = FaceBoundaries(Mesh=conmesh)
planar = IsPlanar(Surface=faceb, Interior=True)  # -> Planar, Plane

# ---- group: unifying meshed
# not sure this is really parametric
extr_2 = Extrude(Base=move_7.Geometry, Direction=amp_4)
brep_4 = Brep(brep_2)
sdiff_2 = SolidDifference(BrepsA=extr_2, BrepsB=brep_4)
splitmul_3 = SplitBrepMultiple(Brep=extr_2, Cutters=brep_4)
splitmul_4 = SplitBrepMultiple(Brep=brep_4, Cutters=extr_2)
item_8 = ListItem(List=splitmul_3, Index=0, Wrap=True)  # -> flatten(Item)
item_9 = ListItem(List=splitmul_4, Index=0, Wrap=True)

# ----
offset = OffsetCurve(Curve=faceb, Distance=expr("-x", Slider(0.1, range=0..0.3)), Plane=planar.Plane, Corners=1)
sdiff_3 = SolidDifference(BrepsA=extrcrv_2, BrepsB=brep_3)
splitmul_5 = SplitBrepMultiple(Brep=extrcrv_2, Cutters=brep_3)
# not sure this is really parametric
splitmul_6 = SplitBrepMultiple(Brep=brep_3, Cutters=extrcrv_2)
explode_2 = Explode(Curve=offset, Recursive=True)  # -> graft(Segments), Vertices
item_10 = ListItem(List=splitmul_5, Index=0, Wrap=True)  # -> flatten(Item)
midpt_2 = CurveMiddle(Curve=explode_2.Segments)
end = EndPoints(Curve=explode_2.Segments)  # -> Start, End
item_11 = ListItem(List=splitmul_6, Index=0, Wrap=True)
panel_9 = Panel(item_10)
meshcp = MeshClosestPoint(Point=midpt_2, Mesh=conmesh)  # -> Point, Index, Parameter
panel_10 = Panel(item_8)
meval = MeshEval(Mesh=conmesh, Parameter=meshcp.Parameter)  # -> Point, Normal, Colour
len = Length(Curve=explode_2.Segments)
multiplication_4 = Multiplication(A=len, B=Slider(0.12, range=0..0.3))
amp_5 = Amplitude(Vector=meval.Normal, Amplitude=multiplication_4)
mesh_10 = Mesh(item_11)
mesh_11 = Mesh(item_10)
mesh_12 = Mesh(item_9)
mesh_13 = Mesh(item_8)
move_8 = Move(Geometry=midpt_2, Motion=amp_5)  # -> Geometry, Transform
merge_3 = Merge(Data1=mesh_10, Data2=mesh_11)  # -> flatten(Result)
arc_2 = Arc3Pt(PointA=end.Start, PointB=move_8.Geometry, PointC=end.End)  # -> simplify(Arc), Plane, Radius
merge_4 = Merge(Data1=mesh_12, Data2=mesh_13)  # -> flatten(Result)
mjoin_2 = MeshJoin(Meshes=merge_3)
pshift = ShiftPaths(Data=arc_2.Arc, Offset=-1)
mjoin_3 = MeshJoin(Meshes=merge_4)
panel_11 = Panel(mjoin_2)
item_12 = ListItem(List=pshift, Index=0, Wrap=True)  # -> Item, Item1, Item2
panel_12 = Panel(mjoin_3)
weldvertices_2 = MeshWeldVertices(Mesh=mjoin_2, Tolerance=0.01)  # -> RuntimeMessage, Mesh
weldvertices_3 = MeshWeldVertices(Mesh=mjoin_3, Tolerance=0.01)  # -> RuntimeMessage, Mesh
edgesrf = EdgeSurface(CurveA=item_12.Item, CurveB=item_12.Item1, CurveC=item_12.Item2)
unifynormals_2 = MeshUnifyNormals(Mesh=weldvertices_2.Mesh)
unifynormals_3 = MeshUnifyNormals(Mesh=weldvertices_3.Mesh)
preview_2 = CustomPreview(
    Geometry=edgesrf,
    Material={diffuse=RGB(221, 160, 221), emission=RGB(66, 48, 66), shine=0.5, specular=RGB(255, 255, 255), transparency=0})
mesh_14 = Mesh(unifynormals_2)
nv_4 = NakedVertices(Mesh=unifynormals_3)  # -> ClothedIndex, NakedIndex, ClothedPts, NakedPts
nv_5 = NakedVertices(Mesh=mesh_14)  # -> ClothedIndex, NakedIndex, ClothedPts, NakedPts
pt_8 = Point(nv_4.NakedPts)
refine_2 = Refine(Mesh=mesh_14, Level=1)
pt_9 = Point(nv_5.NakedPts)
refine_3 = Refine(Mesh=unifynormals_3, Level=1)
number_slider_20 = Slider(0.81, range=0..1)  # disabled

# ---- group: dendro settings / voxel size
number_slider_21 = Slider(0.81, range=0..1)  # disabled
number_slider_22 = Slider(0.747, range=0..10)  # disabled
vsettings = CreateSettings(VoxelSize=number_slider_22, Bandwidth=1, Isovalue=0, Adaptivity=number_slider_21)  # disabled

# ----
mesh_15 = Mesh(refine_2)
mesh_16 = Mesh(refine_3)
medges_2 = MeshEdges(Mesh=mesh_15)  # -> NakedEdges, InteriorEdges, NonManifoldEdges
medges_3 = MeshEdges(Mesh=mesh_16)  # -> NakedEdges, InteriorEdges, NonManifoldEdges

vmesh = MeshToVolume(Settings=vsettings)  # disabled
vunion = VolumeUnion(Volumes=vmesh)  # disabled
mvolume = VolumeToMesh(Volume=vunion, VolumeSettings=vsettings)  # disabled
number_slider_23 = Slider(2, range=0..10)  # disabled
wbcatmullclark_2 = WeaverbirdsCatmullClarkSubdivision(MeshCurves=mvolume, Level=1, SmoothNakedEdges=1)  # disabled
triremesh_2 = TriRemesh(Geometry=wbcatmullclark_2, Length=number_slider_23, Iterations=25)  # -> Triangulation, Dual, Creases; disabled
mesh_17 = Mesh(triremesh_2.Triangulation)  # disabled

line_2 = Line(medges_2.NakedEdges)
line_3 = Line(medges_3.NakedEdges)
panel_13 = Panel("""0
11
14
19""")
join_3 = JoinCurves(Curves=line_2, Preserve=False)
join_4 = JoinCurves(Curves=line_3, Preserve=False)
item_13 = ListItem(Index=0, Wrap=True)
item_14 = ListItem(List=join_4, Index=panel_13, Wrap=True)
number_slider_24 = Slider(2, range=0..10)  # disabled
multiplication_5 = Multiplication(A=Slider(4, range=0..10), B="4")
multiplication_6 = Multiplication(A=Slider(4, range=0..10), B="4")
explode_3 = Explode(Curve=join_3, Recursive=True)  # -> Segments, Vertices
explode_4 = Explode(Curve=item_14, Recursive=True)  # -> Segments, Vertices
divide_5 = DivideCurve(Curve=join_3, Count=multiplication_5, Kinks=False)  # -> Points, Tangents, Parameters
divide_6 = DivideCurve(Curve=item_14, Count=multiplication_6, Kinks=False)  # -> Points, Tangents, Parameters
duppt_2 = RemoveDuplicatePts(Points=divide_5.Points, Tolerance=0.01)
duppt_3 = RemoveDuplicatePts(Points=divide_6.Points, Tolerance=0.01)
plfit_2 = PlaneFit(Points=duppt_2)  # -> Plane, Deviation
avr_3 = Average(Input=duppt_2)
plfit_3 = PlaneFit(Points=duppt_3)  # -> Plane, Deviation
avr_4 = Average(Input=duppt_3)
pl_origin_2 = PlaneOrigin(Base=plfit_2.Plane, Origin=avr_3)
pl_origin_3 = PlaneOrigin(Base=plfit_3.Plane, Origin=avr_4)
cir_3 = Circle(Plane=pl_origin_2, Radius=Slider(10, range=0..10))
cir_4 = Circle(Plane=pl_origin_3, Radius=Slider(10, range=0..10))
crv_cp_3 = CurveClosestPoint(Point=duppt_2, Curve=cir_3)  # -> Point, Parameter, Distance
panel_14 = Panel("-1")
crv_cp_4 = CurveClosestPoint(Point=duppt_3, Curve=cir_4)  # -> Point, Parameter, Distance
pt_10 = Point(simplify(crv_cp_3.Point))
pt_11 = Point(simplify(duppt_2))
pt_12 = Point(simplify(crv_cp_4.Point))
pt_13 = Point(simplify(duppt_3))
Z_6 = UnitZ(Factor=1)
edgelengths_4 = EdgeLengths(Mesh=mesh_15, LengthFactor=Slider(0.501, range=0..1), Strength=1)
anchor_4 = Anchor(Point=pt_11, Target=pt_10, Strength=10000)
anchor_5 = Anchor(Target=pt_6, Strength=10000)
ln_7 = Line(StartPoint=pt_11, EndPoint=pt_10)
show_4 = Show(G=mesh_15)
edgelengths_5 = EdgeLengths(Mesh=mesh_16, LengthFactor=Slider(0.5, range=0..1), Strength=1)
anchor_6 = Anchor(Point=pt_13, Target=pt_12, Strength=10000)
load_2 = Load(ForceVector=Z_6, Weighting=1)
show_5 = Show(G=mesh_16)
ln_8 = Line(StartPoint=pt_13, EndPoint=pt_12)
merge_5 = Merge(Data1=flatten(show_4), Data2=flatten(edgelengths_4), Data3=flatten(anchor_4), Data4=flatten(anchor_5))
merge_6 = Merge(Data1=flatten(show_5), Data2=flatten(edgelengths_5), Data3=flatten(anchor_6))
bouncysolver_2 = BouncySolver(
    GoalObjects=merge_5,
    Reset=Button(),
    Threshold=1e-15,
    Tolerance=0.0001,
    Damping=Slider(0.97, range=0..1),
    Iterations=10,
    On=Toggle(False))  # -> I, V, O
bouncysolver_3 = BouncySolver(
    GoalObjects=merge_6,
    Reset=Button(),
    Threshold=1e-15,
    Tolerance=0.0001,
    Damping=Slider(0.45, range=0..1),
    Iterations=10,
    On=Toggle(False))  # -> I, V, O
previewmat_2 = CustomPreviewMaterials(Geometry=bouncysolver_3.O, DiffuseColor=RGB(255, 255, 255))
previewmat_3 = CustomPreviewMaterials(Geometry=bouncysolver_2.O, DiffuseColor=RGB(255, 255, 255), Transparency=Slider(0.5, range=0..1))
number_slider_25 = Slider(855, range=0..1000)
xy_4 = XYPlane(Origin=Point(0, 0, 0))
sph_4 = Sphere(Base=PlaneXY(0, 0, 0), Radius=Slider(10, range=0..10))
rectangle_6 = Rectangle(Plane=xy_4, XSize=number_slider_25, YSize=number_slider_25, Radius=0)  # -> Rectangle, Length
area_8 = Area(Geometry=rectangle_6.Rectangle)  # -> Area, Centroid
orient_5 = Orient(Geometry=rectangle_6.Rectangle, Source=area_8.Centroid, Target=xy_4)  # -> Geometry, Transform
boundary_4 = BoundarySurfaces(Edges=orient_5.Geometry)
split_2 = SplitBrep(Brep=sph_4, Cutter=boundary_4)
item_15 = ListItem(List=split_2, Index=0, Wrap=True)
brep_5 = Brep(item_15)
debrep_4 = DeconstructBrep(Brep=brep_5)  # -> Faces, Edges, Vertices
item_16 = ListItem(List=debrep_4.Edges, Index=0, Wrap=True)
divide_7 = DivideCurve(Curve=item_16, Count="4", Kinks=False)  # -> Points, Tangents, Parameters
shatter_2 = Shatter(Curve=item_16, Parameters=divide_7.Parameters)
eval_2 = EvaluateCurve(Curve=reparameterize(shatter_2), Parameter=Slider(0.4, range=0..1))  # -> Point, Tangent, Angle
dist_2 = Distance(PointA=divide_7.Points, PointB=eval_2.Point)
ln_9 = Line(StartPoint=divide_7.Points, EndPoint=eval_2.Point)
round_2 = Round(Number=dist_2)  # -> Nearest, Floor, Ceiling
multiplication_7 = Multiplication(A=round_2.Nearest, B="0.5")
midpt_3 = CurveMiddle(Curve=ln_9)
panel_15 = Panel(round_2.Nearest)
Z_7 = UnitZ(Factor=multiplication_7)
move_9 = Move(Geometry=midpt_3, Motion=Z_7)  # -> Geometry, Transform
arc_3 = Arc3Pt(PointA=divide_7.Points, PointB=move_9.Geometry, PointC=eval_2.Point)  # -> Arc, Plane, Radius
pln_6 = Plane(arc_3.Plane)
vec_2 = Vector(pln_6)
amp_6 = Amplitude(Vector=vec_2, Amplitude=Slider(-3, range=-10..10))
move_10 = Move(Geometry=arc_3.Arc, Motion=vec_2)  # -> Geometry, Transform
# not sure this is really parametric
extr_3 = Extrude(Base=move_10.Geometry, Direction=amp_6)
brep_6 = Brep(brep_5)
sdiff_4 = SolidDifference(BrepsA=extr_3, BrepsB=brep_6)
splitmul_7 = SplitBrepMultiple(Brep=brep_6, Cutters=extr_3)
splitmul_8 = SplitBrepMultiple(Brep=extr_3, Cutters=brep_6)
item_17 = ListItem(List=splitmul_8, Index=0, Wrap=True)  # -> flatten(Item)
item_18 = ListItem(List=splitmul_7, Index=0, Wrap=True)
panel_16 = Panel(item_17)
mesh_18 = Mesh(item_18)
mesh_19 = Mesh(item_17)
merge_7 = Merge(Data1=mesh_18, Data2=mesh_19)  # -> flatten(Result)
mjoin_4 = MeshJoin(Meshes=merge_7)
panel_17 = Panel(mjoin_4)
weldvertices_4 = MeshWeldVertices(Mesh=mjoin_4, Tolerance=0.01)  # -> RuntimeMessage, Mesh
unifynormals_4 = MeshUnifyNormals(Mesh=weldvertices_4.Mesh)
project_2 = Project(Geometry=unifynormals_4, Plane=PlaneXY(0, 0, 0))  # -> Geometry, Transform
nv_6 = NakedVertices(Mesh=unifynormals_4)  # -> ClothedIndex, NakedIndex, ClothedPts, NakedPts
pt_14 = Point(nv_6.NakedPts)
refine_4 = Refine(Mesh=unifynormals_4, Level=1)
mesh_20 = Mesh(refine_4)
medges_4 = MeshEdges(Mesh=mesh_20)  # -> NakedEdges, InteriorEdges, NonManifoldEdges
line_4 = Line(medges_4.NakedEdges)
panel_18 = Panel("""0
11
14
19""")
join_5 = JoinCurves(Curves=line_4, Preserve=False)
item_19 = ListItem(Index=0, Wrap=True)
item_20 = ListItem(List=join_5, Index=panel_18, Wrap=True)
multiplication_8 = Multiplication(A=Slider(4, range=0..10), B="4")
explode_5 = Explode(Curve=item_20, Recursive=True)  # -> Segments, Vertices
crv_4 = Curve(join_5)
mesh_21 = Mesh(project_2.Geometry)
divide_8 = DivideCurve(Curve=item_20, Count=multiplication_8, Kinks=False)  # -> Points, Tangents, Parameters
nv_7 = NakedVertices(Mesh=mesh_21)  # -> ClothedIndex, NakedIndex, ClothedPts, NakedPts
duppt_4 = RemoveDuplicatePts(Points=divide_8.Points, Tolerance=0.01)
plfit_4 = PlaneFit(Points=duppt_4)  # -> Plane, Deviation
avr_5 = Average(Input=duppt_4)
neg_3 = Negative()
pt_15 = Point(nv_7.NakedPts)
pl_origin_4 = PlaneOrigin(Base=plfit_4.Plane, Origin=avr_5)

# ---- group: Curve Closest Point
# this is failing
crv_cp_5 = CurveClosestPoint(Point=nv_7.NakedPts, Curve=crv_4)  # -> Point, Parameter, Distance

# ----
edgelengths_6 = EdgeLengths(Mesh=mesh_21, LengthFactor=Slider(1.249, range=0..1.5), Strength=1)
vertexloads = VertexLoads(Mesh=mesh_21, Strength=Slider(0.007, range=0..0.01))
show_6 = Show(G=mesh_21)
cir_5 = Circle(Plane=pl_origin_4, Radius=Slider(10, range=0..10))
anchor_7 = Anchor(Point=nv_7.NakedPts, Target=crv_cp_5.Point, Strength=10000)
merge_8 = Merge(Data1=flatten(vertexloads), Data2=flatten(show_6), Data3=flatten(edgelengths_6), Data4=flatten(anchor_7))
crv_cp_6 = CurveClosestPoint(Point=duppt_4, Curve=cir_5)  # -> Point, Parameter, Distance
number_slider_26 = Slider(0.265, range=0..0.5)
pt_16 = Point(simplify(crv_cp_6.Point))
pt_17 = Point(simplify(duppt_4))
Z_8 = UnitZ(Factor=1)
edgelengths_7 = EdgeLengths(Mesh=mesh_20, LengthFactor=Slider(0.5, range=0..1), Strength=1)
solver_3 = Solver(GoalObjects=merge_8, Reset=Button(), Threshold=1e-15, Tolerance=0.0001, On=Toggle(True))  # -> I, V, O
anchor_8 = Anchor(Point=pt_17, Target=pt_16, Strength=10000)
load_3 = Load(ForceVector=Z_8, Weighting=1)
show_7 = Show(G=mesh_20)
ln_10 = Line(StartPoint=pt_17, EndPoint=pt_16)
previewmat_4 = CustomPreviewMaterials(Geometry=solver_3.O, DiffuseColor=RGB(255, 255, 255))
merge_9 = Merge(Data1=flatten(show_7), Data2=flatten(edgelengths_7), Data3=flatten(anchor_8))
bouncysolver_4 = BouncySolver(
    GoalObjects=merge_9,
    Reset=Button(),
    Threshold=1e-15,
    Tolerance=0.0001,
    Damping=Slider(0.45, range=0..1),
    Iterations=10,
    On=Toggle(False))  # -> I, V, O
previewmat_5 = CustomPreviewMaterials(Geometry=bouncysolver_4.O, DiffuseColor=RGB(255, 255, 255))
