# Grasshopper definition G6-BIMSC24Studio-SITE_v1.gh (Grasshopper 1.0.7)
# plug-ins: Speckle 2

panel = Panel("https://macad.speckle.xyz/streams/4975f9f0a8/branches/site%2F00-federated-model")
receive = Receive(
    Stream=panel,
    AutoReceive=False,
    CurrentComponentState="up_to_date",
    ExpandOutput=True,
    LastInfoMessage="James McBennett @ 01/19/2024 01:06:29: Pushed 38 elements from Grasshopper. (id:b5d4e56588)",
    ReceiveOnOpen=False,
    ReceivedCommitId="b5d4e56588",
    StreamWrapper="https://macad.speckle.xyz/streams/4975f9f0a8/branches/site/00-federated-model",
    selectedKitName="Objects")  # -> Info, CollectionType, Elements, Info_2, Levels, Name, Types
dso = DeconstructSpeckleObject(SpeckleObject=receive.Elements, selectedKitName="Objects")  # -> CollectionType, Elements, Name
panel_2 = Panel(dso.Elements)
panel_3 = Panel(dso.CollectionType)
panel_4 = Panel(dso.Name)
